# Grasshopper definition 2.4 - Create a Tool.gh (Grasshopper 1.0.7)
# plug-ins: HAL for Grasshopper

sessionsettings = SessionSettings()

pt = Point(<point referenced from the Rhino model>)
xy = XYPlane(Origin=Point(0, 0, 0))
mesh = Mesh([<mesh referenced from the Rhino model> x4])
xy_2 = XYPlane(Origin=pt)

panel = Panel("PencilHolder")
tool = Tool(
    Alias=panel,
    Frame=xy,
    Object_Body=mesh,
    ToolFrame=xy_2,
    _0_0=panel,
    _1_0=xy,
    _2_0=mesh,
    _6_0=xy_2,
    Mode=0,
    RunInBackground=False,
    nickName="Tool")
