# Grasshopper definition 2.5 - Calibrate a Tool or Reference.gh (Grasshopper 1.0.7)
# plug-ins: HAL for Grasshopper

# PERS tooldata PencilHolder:=[True,[[-1.25,0,116.87285],[0.9999375,0.0049997,0.0099997,0.00005]],[0.001,[0,0,0.1],[1,0,0,0],0,0,0]];
sessionsettings = SessionSettings()

panel = Panel("-1.25")
panel_2 = Panel("0")
panel_3 = Panel("116.87285")
panel_4 = Panel("0.9999375")
panel_5 = Panel("0.004997")
panel_6 = Panel("0.0099997")
panel_7 = Panel("0.00005")
quaternionframe = QuaternionFrame(
    XMm=panel,
    YMm=panel_2,
    ZMm=panel_3,
    Qw=panel_4,
    Qx=panel_5,
    Qy=panel_6,
    Qz=panel_7,
    _0_0=panel,
    _1_0=panel_2,
    _2_0=panel_3,
    _3_0=panel_4,
    _4_0=panel_5,
    _5_0=panel_6,
    _6_0=panel_7,
    Mode=0,
    RunInBackground=False,
    nickName="QuaternionFrame")
xy = XYPlane(Origin=Point(0, 0, 0))
mesh = Mesh([<mesh referenced from the Rhino model> x4])

panel_8 = Panel("PencilHolder")
tool = Tool(
    Alias=panel_8,
    Frame=xy,
    Object_Body=mesh,
    ToolFrame=quaternionframe,
    _0_0=panel_8,
    _1_0=xy,
    _2_0=mesh,
    _6_0=quaternionframe,
    Mode=0,
    RunInBackground=False,
    nickName="Tool")
