# Grasshopper definition 5.5 - Custom Action.gh (Grasshopper 1.0.7)
# plug-ins: HAL for Grasshopper

sessionsettings = SessionSettings()  # -> Data, DefaultSettings

# ---- group: [Optional] Wait for Time
number_slider = Slider(0.5, range=0..1)
panel = Panel("Wait")
waittime = WaitTime(Alias=panel, DurationS=number_slider, _0_0=panel, _1_0=number_slider, Mode=0, RunInBackground=False, nickName="WaitTime")

# ---- group: Custom Action
panel_2 = Panel("TPWrite \"Hello Robot\";")
panel_3 = Panel("Notify Operator")
custom = CustomAction(
    Alias=panel_3,
    Code=panel_2,
    Simulation=waittime,
    _0_0=panel_3,
    _1_0=panel_2,
    _2_0=waittime,
    Mode=0,
    RunInBackground=False,
    nickName="Custom")

# ---- group: Merge and Combine
merge = Merge(Data1=flatten(custom))
combine = CombineActions(Object_Combined=merge, Compact=True, _1_0=merge, Mode=0, RunInBackground=False, nickName="Combine")
