# Grasshopper definition 2.2 - Create a Reference.gh (Grasshopper 1.0.7)
# plug-ins: HAL for Grasshopper

sessionsettings = SessionSettings()

# ---- group: Simple Reference
corner = Point(<point referenced from the Rhino model>)
panel = Panel("BoxCorner")
xy = XYPlane(Origin=corner)
reference = CreateReference(Alias=panel, Frame=xy, _0_0=panel, _1_0=xy, Mode=0, RunInBackground=False, nickName="Reference")

# ---- group: Referenced Reference
number_slider = Slider(150, range=0..1000)
number_slider_2 = Slider(0, range=-180..180)
panel_2 = Panel("OverBox")
eulerframe = EulerFrame(
    XMm=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,
    YMm=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,
    ZMm=number_slider,
    AxisA={halEnum=2, halEnumType="HAL.Spatial.Axis"},
    AxisB={halEnum=1, halEnumType="HAL.Spatial.Axis"},
    AxisC={halEnum=0, halEnumType="HAL.Spatial.Axis"},
    AngleA=number_slider_2,
    AngleBRad=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,
    AngleCRad=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,
    _2_0=number_slider,
    _6_0=number_slider_2,
    Mode=0,
    RunInBackground=False,
    nickName="EulerFrame")
reference_2 = CreateReference(
    Alias=panel_2,
    Frame=eulerframe,
    Parent=reference,
    IsAbsolute=invert(True),
    _0_0=panel_2,
    _1_0=eulerframe,
    _2_0=reference,
    Mode=0,
    RunInBackground=False,
    nickName="Reference")

# ---- group: Absolute Targets
crvinworld = Curve(<curve referenced from the Rhino model>)
target = Target(
    Alias="Curve",
    Curve=crvinworld,
    Discretization={halEnum=1, halEnumType="HAL.McNeel.RhinoCommon5.Spatial.CurveDiscretization"},
    ToleranceMm=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,
    Reference=reference,
    IsAbsolute=True,
    _1_0=crvinworld,
    _4_0=reference,
    Mode=0,
    RunInBackground=False,
    nickName="Target")  # -> Object_Target, Trace
target_2 = TargetProperties(Target=target.Object_Target, _0_0=target, Mode=0, RunInBackground=False, nickName="Target")  # -> Alias, Object_Joint, WayFrame, EndFrame, Reference, IsArc
panel_3 = Panel(target_2.Reference)

# ---- group: Relative Targets
crvatorigin = Curve(<curve referenced from the Rhino model>)
target_3 = Target(
    Alias="Curve",
    Curve=crvatorigin,
    Discretization={halEnum=1, halEnumType="HAL.McNeel.RhinoCommon5.Spatial.CurveDiscretization"},
    ToleranceMm=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,
    Reference=reference_2,
    IsAbsolute=invert(True),
    _1_0=crvatorigin,
    _4_0=reference_2,
    Mode=0,
    RunInBackground=False,
    nickName="Target")  # -> Object_Target, Trace
