# Grasshopper definition 2.3 - Create a Part.gh (Grasshopper 1.0.7)
# plug-ins: HAL for Grasshopper

sessionsettings = SessionSettings()

# ---- group: Compound Part
panel = Panel("Cone")
xy = XYPlane(Origin=Point(0, 0, 0))
cone = Brep([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])
swatch = ColourSwatch(SwatchColor=RGB(0, 170, 255))
part = MechanicalPart(
    Alias=panel,
    Frame=xy,
    Object_Body=cone,
    Object_Color=swatch,
    _0_0=panel,
    _1_0=xy,
    _2_0=cone,
    _3_0=swatch,
    Mode=0,
    RunInBackground=False,
    nickName="Part")

# ---- group: Simple Part
panel_2 = Panel("Box")
xy_2 = XYPlane(Origin=Point(0, 0, 0))
box = Brep(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)
part_2 = MechanicalPart(
    Alias=panel_2,
    Frame=xy_2,
    Object_Body=box,
    _0_0=panel_2,
    _1_0=xy_2,
    _2_0=box,
    Mode=0,
    RunInBackground=False,
    nickName="Part")

# ---- group: Move Part
vec = VectorXYZ(XComponent=Slider(0, range=0..1000), YComponent=0, ZComponent=0)  # -> Vector, Length
relocate = RelocatePart(Part=part_2, Location=vec.Vector, _0_0=part_2, _1_0=vec, Mode=0, RunInBackground=False, nickName="Relocate")

# ---- group: Attach Parts
vec_2 = VectorXYZ(XComponent=0, YComponent=0, ZComponent=Slider(250, range=0..1000))  # -> Vector, Length
attachparts = AttachParts(
    Parent=relocate,
    Child=part,
    Location=vec_2.Vector,
    FromWorld=invert(True),
    _0_0=relocate,
    _1_0=part,
    _2_0=vec_2,
    Mode=0,
    RunInBackground=False,
    nickName="AttachParts")  # -> Part, Connection
