# Grasshopper definition 3.1 - Create a Target.gh (Grasshopper 1.0.7)
# plug-ins: HAL for Grasshopper

sessionsettings = SessionSettings()

# ---- group: Cartesian Targets / Target Point
pt = Point(Point(504.418436, -39.32957744, 379.2918869))

# ---- group: Joint Target / Robot for Target
robot = Robot(
    Alias="Robot",
    Mode=0,
    RunInBackground=False,
    catalogItem="Mechanism,1ee2801b-9834-4b40-a6d4-d961b1583ad5",
    nickName="⧉ Robot")

# ---- group: Joint Target / Joint Values
merge = Merge(
    Data1=Slider(0, range=-3.142..3.142),
    Data2=Slider(0, range=-3.142..3.142),
    Data3=Slider(0, range=-3.142..3.142),
    Data4=Slider(0, range=-3.142..3.142),
    Data5=Slider(0, range=-3.142..3.142),
    Data6=Slider(0, range=-3.142..3.142))

# ---- group: Targets from Curve / Curve to Follow
crv = Curve(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)

# ---- group: Targets from Curve
number_slider = Slider(1, range=1..100)

# ---- group: Cartesian Targets / Target from Frame
xy = XYPlane(Origin=pt)
panel = Panel("AlignedWithWorld")
target = Target(Object_Alias=panel, Object_Frame=xy, InWorld=True, _0_0=panel, _1_0=xy, Mode=0, RunInBackground=False, nickName="Target")

# ---- group: Targets from Curve / Curve to Targets
target_2 = Target(
    Alias="Curve",
    Curve=crv,
    Discretization={halEnum=1, halEnumType="HAL.McNeel.RhinoCommon5.Spatial.CurveDiscretization"},
    ToleranceMm=number_slider,
    InWorld=True,
    _1_0=crv,
    _3_0=number_slider,
    Mode=0,
    RunInBackground=False,
    nickName="Target")  # -> Object_Target, Trace

# ---- group: Cartesian Targets / Target Facing Down Shortcut
target_3 = Target(pt)

# ---- group: Joint Target / Target from Joint Positions
target_4 = Target(Mechanism=robot, Object_Position=merge, _1_0=robot, _2_0=merge, Mode=0, RunInBackground=False, nickName="Target")
