# Grasshopper definition 3.2 - Modify a Target.gh (Grasshopper 1.0.7)
# plug-ins: HAL for Grasshopper

sessionsettings = SessionSettings()

# ---- group: Base Targets
crv = Curve(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)
lines = Discretization({halEnum=1, halEnumType="HAL.McNeel.RhinoCommon5.Spatial.CurveDiscretization"})
target = Target(
    Alias="Curve",
    Curve=crv,
    Discretization=lines,
    ToleranceMm=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,
    InWorld=True,
    _1_0=crv,
    _2_0=lines,
    Mode=0,
    RunInBackground=False,
    nickName="Target")  # -> Object_Target, Trace
targets = Target(target.Object_Target)

# ---- group: Align to Vector
targets_2 = Target(targets)
target_2 = TargetProperties(Target=targets_2, _0_0=targets_2, Mode=0, RunInBackground=False, nickName="Target")  # -> Alias, Object_Joint, WayFrame, EndFrame, Reference, IsArc
targets_3 = Target(targets)

# ---- group: Free Transform Relative to Target
targets_4 = Target(targets)
number_slider = Slider(-28, range=-100..100)
number_slider_2 = Slider(27, range=-180..180)
transform = Transform(
    Target=targets_4,
    XMm=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,
    YMm=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,
    ZMm=number_slider,
    RXRad=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,
    RYRad=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,
    RZ=number_slider_2,
    _0_0=targets_4,
    _4_0=number_slider,
    _7_0=number_slider_2,
    Mode=0,
    RunInBackground=False,
    nickName="Transform")

# ---- group: Filter Targets / Overzealous Curve Division
crv_2 = Curve(crv)
divide = DivideCurve(Curve=crv_2, Count=1000, Kinks=False)  # -> Points, Tangents, Parameters
target_3 = Target(divide.Points)

# ---- group: Align to Vector / Robot Base Location
xy = XYPlane(Origin=Point(0, 0, 0))

# ---- group: Align to Vector / Prepare Vector
vec2pt = Vector2Pt(PointA=xy, PointB=target_2.EndFrame, Unitize=False)  # -> Vector, Length
devec = DeconstructVector(Vector=vec2pt.Vector)  # -> XComponent, YComponent, ZComponent
vec = VectorXYZ(XComponent=devec.XComponent, YComponent=devec.YComponent, ZComponent=0)  # -> Vector, Length

# ---- group: Filter Targets
number_slider_3 = Slider(10, range=0..10)
filter = TargetFilter(
    Object_Target=target_3,
    PositionMm=number_slider_3,
    OrientationRad=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,
    _0_0=target_3,
    _1_0=number_slider_3,
    Mode=0,
    RunInBackground=False,
    nickName="Filter")  # -> Object_Remaining, Object_Discarded, Object_Mask

# ---- group: Align to Vector / Align -X to Vector
parallel = Parallel(
    Target=targets_3,
    Direction=vec.Vector,
    Axis={halEnum=0, halEnumType="HAL.Spatial.Axis"},
    Flip=invert(False),
    Project=False,
    _0_0=targets_3,
    _2_0=vec,
    Mode=0,
    RunInBackground=False,
    nickName="Parallel")

# ---- group: Filter Targets / Remaining Targets
ma = MassAddition(Input=filter.Object_Mask)  # -> Result, PartialResults
target_4 = Target(filter.Object_Remaining)
panel = Panel(ma.Result)
