# Grasshopper definition 4.1 - Create a Signal.gh (Grasshopper 1.0.7)
# plug-ins: HAL for Grasshopper

sessionsettings = SessionSettings()

# ---- group: ABB
panel = Panel("DO_01")
doutput = DigitalOutput(
    Alias=panel,
    LowV=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,
    HighV=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,
    Default=False,
    _0_0=panel,
    Mode=0,
    RunInBackground=False,
    nickName="DOutput")

# ---- group: KUKA
panel_2 = Panel("1")
doutput_2 = DigitalOutput(
    Alias=panel_2,
    LowV=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,
    HighV=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,
    Default=False,
    _0_0=panel_2,
    Mode=0,
    RunInBackground=False,
    nickName="DOutput")

# ---- group: Universal Robots
panel_3 = Panel("2")
doutput_3 = DigitalOutput(
    Alias=panel_3,
    LowV=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,
    HighV=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,
    Default=False,
    _0_0=panel_3,
    Mode=0,
    RunInBackground=False,
    nickName="DOutput")

# ---- group: Staubli
panel_4 = Panel("FastIO\fOut1")
doutput_4 = DigitalOutput(
    Alias=panel_4,
    LowV=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,
    HighV=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,
    Default=False,
    _0_0=panel_4,
    Mode=0,
    RunInBackground=False,
    nickName="DOutput")

# ---- group: KUKA
digitaloutput_1 = ElectricSignal(doutput_2)

# ---- group: Universal Robots
digitaloutput_2 = ElectricSignal(doutput_3)

# ---- group: Staubli
fastio_fout1 = ElectricSignal(doutput_4)

# ---- group: ABB
do_01 = ElectricSignal(doutput)
