# Grasshopper definition 4.2 - Change a Signal State.gh (Grasshopper 1.0.7)
# plug-ins: HAL for Grasshopper

sessionsettings = SessionSettings()

# ---- group: Create Signal
panel = Panel("DO_01")
doutput = DigitalOutput(
    Alias=panel,
    LowV=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,
    HighV=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,
    Default=False,
    _0_0=panel,
    Mode=0,
    RunInBackground=False,
    nickName="DOutput")

do_01 = ElectricSignal(doutput)

# ---- group: Set Signal State
toggle = BooleanToggle(True)
set = Effect({halEnum=1, halEnumType="HAL.Procedures.Actions.SignalEffect"})
panel_2 = Panel("SetDO_01")
setdo = SetDigitalOutputSignal(
    Alias=panel_2,
    Signal=do_01,
    Effect=set,
    State=toggle,
    _0_0=panel_2,
    _1_0=do_01,
    _2_0=set,
    _3_0=toggle,
    Mode=0,
    RunInBackground=False,
    nickName="SetDO")

# ---- group: Merge and Combine
merge = Merge(Data1=flatten(setdo))
combine = CombineActions(Object_Combined=merge, Compact=True, _1_0=merge, Mode=0, RunInBackground=False, nickName="Combine")
