# Grasshopper definition 5.1 - Wait for a Time.gh (Grasshopper 1.0.7)
# plug-ins: HAL for Grasshopper

sessionsettings = SessionSettings()

# ---- group: Wait for Time
number_slider = Slider(0.5, range=0..1)
panel = Panel("Wait")
waittime = WaitTime(Alias=panel, DurationS=number_slider, _0_0=panel, _1_0=number_slider, Mode=0, RunInBackground=False, nickName="WaitTime")

# ---- group: Merge and Combine
merge = Merge(Data1=flatten(waittime))
combine = CombineActions(Object_Combined=merge, Compact=True, _1_0=merge, Mode=0, RunInBackground=False, nickName="Combine")
